# Dynamo graph Apex Haunch.dyn (Dynamo 2.1.0.7500)

# group: Selects the input elements, structures into connection nodes and takes sub nodes of 2 elements.
select_steel_elements = SelectStructureData()  # nothing selected; graph input
fromStructure = AdvanceSteel.ConnectionAutomation.Nodes.ConnectionNode.FromStructure(objects=select_steel_elements)
code_block = CodeBlock { 2; }
subNodesOfSize = AdvanceSteel.ConnectionAutomation.Nodes.ConnectionNode.SubNodesOfSize(node=fromStructure, noOfZones=code_block)

# group: Defines the zones for which the elements are joining each other to create a connection.
code_block_2 = CodeBlock { 0; "End"; }
byZoneType = AdvanceSteel.ConnectionAutomation.Nodes.Filter.ByZoneType(node=subNodesOfSize, index=code_block_2.out0, zoneType=code_block_2.out1)
code_block_3 = CodeBlock { 1; "End"; }
byZoneType_2 = AdvanceSteel.ConnectionAutomation.Nodes.Filter.ByZoneType(node=byZoneType.accepted, index=code_block_3.out0, zoneType=code_block_3.out1)

# group: Filters the input elements so that they have parallel webs using the "Y" axis.
code_block_4 = CodeBlock { 0; 1; "Y"; "Y"; 0; 0; }
byAngleBetweenAxes = AdvanceSteel.ConnectionAutomation.Nodes.Filter.ByAngleBetweenAxes(node=byZoneType_2.accepted, indexFirst=code_block_4.out0, indexSecond=code_block_4.out1, axisFirst=code_block_4.out2, axisSecond=code_block_4.out3, rangeStart=code_block_4.out4, rangeEnd=code_block_4.out5)

# group: Filters the input elements based on the slant angle of the elements using a range between 0 and 90 degrees for both input elements.
code_block_5 = CodeBlock { 0; }
beam_1_slope_angle_range_from = DoubleInput(0)  # graph input
beam_1_slope_angle_range_to = DoubleInput(90)  # graph input
bySlopeAngle = AdvanceSteel.ConnectionAutomation.Nodes.Filter.BySlopeAngle(node=byAngleBetweenAxes.accepted, index=code_block_5, rangeStart=beam_1_slope_angle_range_from, rangeEnd=beam_1_slope_angle_range_to)
code_block_6 = CodeBlock { 1; }
beam_2_slope_angle_range_from = DoubleInput(0)  # graph input
beam_2_slope_angle_range_to = DoubleInput(90)  # graph input
bySlopeAngle_2 = AdvanceSteel.ConnectionAutomation.Nodes.Filter.BySlopeAngle(node=bySlopeAngle.accepted, index=code_block_6, rangeStart=beam_2_slope_angle_range_from, rangeEnd=beam_2_slope_angle_range_to)

# group: Filters both input elements based on Section Type. The Apex Haunch connection is supported only when both input elements have the same Section Type.
code_block_7 = CodeBlock { 0; }
main_and_secondary_input = StructuralDataTypes("Any | Any")  # "Main and secondary input elements section"; graph input
bySectionType = AdvanceSteel.ConnectionAutomation.Nodes.Filter.BySectionType(node=bySlopeAngle_2.accepted, index=code_block_7, nameToFind=main_and_secondary_input.typeName)
code_block_8 = CodeBlock { 1; }
bySectionType_2 = AdvanceSteel.ConnectionAutomation.Nodes.Filter.BySectionType(node=bySectionType.accepted, index=code_block_8, nameToFind=main_and_secondary_input.typeName)

# group: Eliminates duplicate connection nodes, such as [BeamA, BeamB] and [BeamB, BeamA].
removeDuplicates = AdvanceSteel.ConnectionAutomation.Nodes.ConnectionNode.RemoveDuplicates(nodes=bySectionType_2.accepted)

# group: Creates an Apex Haunch connection ordering input elements by their indexes.
code_block_9 = CodeBlock { [0,1]; }
connection_type_to_add_in_model = ConnectionTypes()  # nothing selected; graph input
byType = AdvanceSteel.ConnectionAutomation.Nodes.Connection.ByType(node=removeDuplicates, indexes=code_block_9, connectionType=connection_type_to_add_in_model)

# group: Displays the number of created connections per run.
code_block_10 = CodeBlock { false; }
clean = List.Clean(list=byType.Connection, preserveIndices=code_block_10)
flatten = List.Flatten(list=clean)
count = List.Count(list=flatten)
number_of_created_connections = Watch(count)  # graph output

# group: Displays the number of connection nodes where connections already existed.
code_block_11 = CodeBlock { false; }
clean_2 = List.Clean(list=byType.Existing, preserveIndices=code_block_11)
flatten_2 = List.Flatten(list=clean_2)
count_2 = List.Count(list=flatten_2)
number_of_existing_connections = Watch(count_2)  # graph output
