# Dynamo graph Clip angle - beam to column By Analysis Results.dyn (Dynamo 2.1.0.7500)

# group: Selects the input elements, structures them into connection nodes and takes sub nodes of 2 elements.
select_steel_elements = SelectStructureData()  # nothing selected; graph input
fromStructure = AdvanceSteel.ConnectionAutomation.Nodes.ConnectionNode.FromStructure(objects=select_steel_elements)
code_block = CodeBlock { 2; }
subNodesOfSize = AdvanceSteel.ConnectionAutomation.Nodes.ConnectionNode.SubNodesOfSize(node=fromStructure, noOfZones=code_block)

# group: Defines the zones for which the elements are joining each other to create a connection.
code_block_2 = CodeBlock { 0; "Body"; }
byZoneType = AdvanceSteel.ConnectionAutomation.Nodes.Filter.ByZoneType(node=subNodesOfSize, index=code_block_2.out0, zoneType=code_block_2.out1)
code_block_3 = CodeBlock { 1; "End"; }
byZoneType_2 = AdvanceSteel.ConnectionAutomation.Nodes.Filter.ByZoneType(node=byZoneType.accepted, index=code_block_3.out0, zoneType=code_block_3.out1)

# group: Filters the main input elements based on slant angle. For a range between 0 and 0 it identifies connection nodes where the main input element is vertical. By increasing the range it will identify slanted columns as well.
code_block_4 = CodeBlock { 0; }
slant_angle_for_main_input = DoubleInput(0)  # "Slant angle for main input element. Range start from"
slant_angle_for_main_input_2 = DoubleInput(0)  # "Slant angle for main input element. Range end to"
bySlantAngle = AdvanceSteel.ConnectionAutomation.Nodes.Filter.BySlantAngle(node=byZoneType_2.accepted, index=code_block_4, rangeStart=slant_angle_for_main_input, rangeEnd=slant_angle_for_main_input_2)

# group: Filters the input elements based on Section Type.
code_block_5 = CodeBlock { 0; }
main_element_type = StructuralDataTypes("Any | Any")  # graph input
bySectionType = AdvanceSteel.ConnectionAutomation.Nodes.Filter.BySectionType(node=bySlantAngle.accepted, index=code_block_5, nameToFind=main_element_type.typeName)
code_block_6 = CodeBlock { 1; }
secondary_element_type = StructuralDataTypes("Any | Any")  # graph input
bySectionType_2 = AdvanceSteel.ConnectionAutomation.Nodes.Filter.BySectionType(node=bySectionType.accepted, index=code_block_6, nameToFind=secondary_element_type.typeName)

# group: Filters the input elements to identify the beam orientation cases supported by the clip angle connection using a filter for the angle made by the vectors of the input elements axis. E.g. the clip angle connection connects the main and second elements using straight angle cleats. The connection is not created if the cleats need to be skewed in order to connect the input elements.
code_block_7 = CodeBlock { 0; 1; "y"; "y"; 89; 90; }
byAngleBetweenAxes = AdvanceSteel.ConnectionAutomation.Nodes.Filter.ByAngleBetweenAxes(node=bySectionType_2.accepted, indexFirst=code_block_7.out0, indexSecond=code_block_7.out1, axisFirst=code_block_7.out2, axisSecond=code_block_7.out3, rangeStart=code_block_7.out4, rangeEnd=code_block_7.out5)
code_block_8 = CodeBlock { 0; 1; "y"; "y"; 0; 1; }
byAngleBetweenAxes_2 = AdvanceSteel.ConnectionAutomation.Nodes.Filter.ByAngleBetweenAxes(node=byAngleBetweenAxes.rejected, indexFirst=code_block_8.out0, indexSecond=code_block_8.out1, axisFirst=code_block_8.out2, axisSecond=code_block_8.out3, rangeStart=code_block_8.out4, rangeEnd=code_block_8.out5)
list_create = List.Create(item0=byAngleBetweenAxes.accepted, item1=byAngleBetweenAxes_2.accepted)

# group: Filters the secondary input element by the slope angle.
code_block_9 = CodeBlock { 1; }
slope_for_secondary_element = DoubleInput(0)  # "Slope for secondary element. Range start from"; graph input
slope_for_secondary_element_2 = DoubleInput(90)  # "Slope for secondary element. Range ends to"; graph input
bySlopeAngle = AdvanceSteel.ConnectionAutomation.Nodes.Filter.BySlopeAngle(node=list_create, index=code_block_9, rangeStart=slope_for_secondary_element, rangeEnd=slope_for_secondary_element_2)

# group: Filters the input element based on Analysis Results
code_block_10 = CodeBlock { 1; }
type_of_result = ResultTypes()  # nothing selected; graph input
load_case_combination_envelope = AnalysisResults("No Analysis Results found")  # graph input
beam_result_range_from = DoubleInput(0)  # graph input
beam_result_range_to = DoubleInput(0)  # graph input
byAnalysisResults = AdvanceSteel.ConnectionAutomation.Nodes.Filter.ByAnalysisResults(node=bySlopeAngle.accepted, index=code_block_10, resultType=type_of_result, analysisResult=load_case_combination_envelope, rangeStart=beam_result_range_from, rangeEnd=beam_result_range_to)

# group: Creates a Clip Angle connection, ordering input elements by their indexes.
code_block_11 = CodeBlock { [0,1]; }
connection_type_to_add_in_model = ConnectionTypes()  # nothing selected; graph input
byType = AdvanceSteel.ConnectionAutomation.Nodes.Connection.ByType(node=byAnalysisResults.accepted, indexes=code_block_11, connectionType=connection_type_to_add_in_model)

# group: Displays the number of created connections per run.
code_block_12 = CodeBlock { false; }
clean = List.Clean(list=byType.Connection, preserveIndices=code_block_12)
flatten = List.Flatten(list=clean)
count = List.Count(list=flatten)
number_of_created_connections = Watch(count)  # graph output

# group: Displays the number of connection nodes where connections already existed.
code_block_13 = CodeBlock { false; }
clean_2 = List.Clean(list=byType.Existing, preserveIndices=code_block_13)
flatten_2 = List.Flatten(list=clean_2)
count_2 = List.Count(list=flatten_2)
number_of_existing_connections = Watch(count_2)  # graph output
