# Dynamo graph Double Side Clip Angle.dyn (Dynamo 2.1.0.7500)

# group: Selects the input elements, structures them into connection nodes and takes sub nodes of 3 elements.
select_steel_elements = SelectStructureData()  # nothing selected; graph input
fromStructure = AdvanceSteel.ConnectionAutomation.Nodes.ConnectionNode.FromStructure(objects=select_steel_elements)
code_block = CodeBlock { 3; }
subNodesOfSize = AdvanceSteel.ConnectionAutomation.Nodes.ConnectionNode.SubNodesOfSize(node=fromStructure, noOfZones=code_block)

# group: Defines the zones that join to create the connection. This filters the connection nodes where the "End" of the secondary input elements connects to the "Body" of the main input element.
code_block_2 = CodeBlock { 0; "Body"; }
byZoneType = AdvanceSteel.ConnectionAutomation.Nodes.Filter.ByZoneType(node=subNodesOfSize, index=code_block_2.out0, zoneType=code_block_2.out1)
code_block_3 = CodeBlock { 1; "End"; }
byZoneType_2 = AdvanceSteel.ConnectionAutomation.Nodes.Filter.ByZoneType(node=byZoneType.accepted, index=code_block_3.out0, zoneType=code_block_3.out1)
code_block_4 = CodeBlock { 2; "End"; }
byZoneType_3 = AdvanceSteel.ConnectionAutomation.Nodes.Filter.ByZoneType(node=byZoneType_2.accepted, index=code_block_4.out0, zoneType=code_block_4.out1)

# group: Filters the input elements where the main input element creates an angle of 90 degrees with each secondary input element.
code_block_5 = CodeBlock { 0; 1; "x"; "x"; 90; 90; }
byAngleBetweenAxes = AdvanceSteel.ConnectionAutomation.Nodes.Filter.ByAngleBetweenAxes(node=byZoneType_3.accepted, indexFirst=code_block_5.out0, indexSecond=code_block_5.out1, axisFirst=code_block_5.out2, axisSecond=code_block_5.out3, rangeStart=code_block_5.out4, rangeEnd=code_block_5.out5)
code_block_6 = CodeBlock { 0; 2; "x"; "x"; 90; 90; }
byAngleBetweenAxes_2 = AdvanceSteel.ConnectionAutomation.Nodes.Filter.ByAngleBetweenAxes(node=byAngleBetweenAxes.accepted, indexFirst=code_block_6.out0, indexSecond=code_block_6.out1, axisFirst=code_block_6.out2, axisSecond=code_block_6.out3, rangeStart=code_block_6.out4, rangeEnd=code_block_6.out5)

# group: Filters the input elements where the angle between the second and the third input elements is 180 degrees, qualifying for the Double Side Clip Angle connection node where these beams need to be colinear.
code_block_7 = CodeBlock { 1; 2; 180; 180; }
byAngleBetweenBeams = AdvanceSteel.ConnectionAutomation.Nodes.Filter.ByAngleBetweenBeams(node=byAngleBetweenAxes_2.accepted, indexFirst=code_block_7.out0, indexSecond=code_block_7.out1, rangeStart=code_block_7.out2, rangeEnd=code_block_7.out3)

# group: Filters the input elements by Section Type.
code_block_8 = CodeBlock { 0; }
main_beam_s_section_type = StructuralDataTypes("Any | Any")  # graph input
bySectionType = AdvanceSteel.ConnectionAutomation.Nodes.Filter.BySectionType(node=byAngleBetweenBeams.accepted, index=code_block_8, nameToFind=main_beam_s_section_type.typeName)
code_block_9 = CodeBlock { 1; }
first_secondary_beam_s_section = StructuralDataTypes("Any | Any")  # "First secondary beam's section type"; graph input
bySectionType_2 = AdvanceSteel.ConnectionAutomation.Nodes.Filter.BySectionType(node=bySectionType.accepted, index=code_block_9, nameToFind=first_secondary_beam_s_section.typeName)
code_block_10 = CodeBlock { 2; }
second_secondary_beam_s_section = StructuralDataTypes("Any | Any")  # "Second secondary beam's section type"; graph input
bySectionType_3 = AdvanceSteel.ConnectionAutomation.Nodes.Filter.BySectionType(node=bySectionType_2.accepted, index=code_block_10, nameToFind=second_secondary_beam_s_section.typeName)

# group: Eliminate duplicate connection nodes, such as [BeamA, BeamB] and [BeamB, BeamA].
removeDuplicates = AdvanceSteel.ConnectionAutomation.Nodes.ConnectionNode.RemoveDuplicates(nodes=bySectionType_3.accepted)

# group: Creates a Double Side Clip Angle connection, ordering input elements by their indexes.
code_block_11 = CodeBlock { [0,1,2]; }
connection_type_to_add_in_model = ConnectionTypes()  # nothing selected; graph input
byType = AdvanceSteel.ConnectionAutomation.Nodes.Connection.ByType(node=removeDuplicates, indexes=code_block_11, connectionType=connection_type_to_add_in_model)

# group: Displays the number of created connections per run.
code_block_12 = CodeBlock { false; }
clean = List.Clean(list=byType.Connection, preserveIndices=code_block_12)
flatten = List.Flatten(list=clean)
count = List.Count(list=flatten)
number_of_created_connections = Watch(count)  # graph output

# group: Displays the number of connection nodes where connections already existed.
code_block_13 = CodeBlock { false; }
clean_2 = List.Clean(list=byType.Existing, preserveIndices=code_block_13)
flatten_2 = List.Flatten(list=clean_2)
count_2 = List.Count(list=flatten_2)
number_of_existed_connections = Watch(count_2)  # graph output
