# Dynamo graph End Plate.dyn (Dynamo 2.1.0.7500)

# group: Selects the input elements, structures them into connection nodes and takes sub nodes of 1 element.
select_steel_elements = SelectStructureData()  # nothing selected; graph input
fromStructure = AdvanceSteel.ConnectionAutomation.Nodes.ConnectionNode.FromStructure(objects=select_steel_elements)
code_block = CodeBlock { 1; }
subNodesOfSize = AdvanceSteel.ConnectionAutomation.Nodes.ConnectionNode.SubNodesOfSize(node=fromStructure, noOfZones=code_block)

# group: Filters the input elements by the zone where the connection is added and by the Section Type of the input element.
code_block_2 = CodeBlock { 0; "End"; }
byZoneType = AdvanceSteel.ConnectionAutomation.Nodes.Filter.ByZoneType(node=subNodesOfSize, index=code_block_2.out0, zoneType=code_block_2.out1)
code_block_3 = CodeBlock { 0; }
beam_type_to_add_end_plate = StructuralDataTypes("Any | Any")  # "Beam type to add end plate connection on"; graph input
bySectionType = AdvanceSteel.ConnectionAutomation.Nodes.Filter.BySectionType(node=byZoneType.accepted, index=code_block_3, nameToFind=beam_type_to_add_end_plate.typeName)

# group: Creates an End Plate connection, ordering input elements by their indexes.
code_block_4 = CodeBlock { 0; }
connection_type_to_add_in_model = ConnectionTypes()  # nothing selected; graph input
byType = AdvanceSteel.ConnectionAutomation.Nodes.Connection.ByType(node=bySectionType.accepted, indexes=code_block_4, connectionType=connection_type_to_add_in_model)

# group: Displays the number of created connections per run.
code_block_5 = CodeBlock { false; }
clean = List.Clean(list=byType.Connection, preserveIndices=code_block_5)
flatten = List.Flatten(list=clean)
count = List.Count(list=flatten)
number_of_created_connections = Watch(count)  # graph output

# group: Displays the number of connection nodes where connections already existed.
code_block_6 = CodeBlock { false; }
clean_2 = List.Clean(list=byType.Existing, preserveIndices=code_block_6)
flatten_2 = List.Flatten(list=clean_2)
count_2 = List.Count(list=flatten_2)
number_of_existing_connections = Watch(count_2)  # graph output
