# Dynamo graph Gable Wall End Plate.dyn (Dynamo 2.2.1.5175)

# group: Selects the input elements, structures them into connection nodes and takes sub nodes of 2 elements.
select_steel_elements = SelectStructureData()  # nothing selected; graph input
fromStructure = AdvanceSteel.ConnectionAutomation.Nodes.ConnectionNode.FromStructure(objects=select_steel_elements)
code_block = CodeBlock { 2; }
subnodesOfSize = AdvanceSteel.ConnectionAutomation.Nodes.ConnectionNode.SubNodesOfSize(node=fromStructure, noOfZones=code_block)

# group: Filters the input elements where the main element is horizontal and enters the connection with the "body" and second element (column) is straight and enters the connection with the "end" of the element.
code_block_2 = CodeBlock { 1; 0; 0; }
bySlantAngle = AdvanceSteel.ConnectionAutomation.Nodes.Filter.BySlantAngle(node=subnodesOfSize, index=code_block_2.out0, rangeStart=code_block_2.out1, rangeEnd=code_block_2.out2)
code_block_3 = CodeBlock { 0; "Body"; }
byZoneType = AdvanceSteel.ConnectionAutomation.Nodes.Filter.ByZoneType(node=bySlantAngle.accepted, index=code_block_3.out0, zoneType=code_block_3.out1)
code_block_4 = CodeBlock { 1; "End"; }
byZoneType_2 = AdvanceSteel.ConnectionAutomation.Nodes.Filter.ByZoneType(node=byZoneType.accepted, index=code_block_4.out0, zoneType=code_block_4.out1)

# group: Custom node that filters the second element (rafter) by section shape I and C, to support creating the Gable wall end plate connection.
code_block_5 = CodeBlock { 0; }
byIOrCSectionShape = Custom[Filter.ByIOrCSectionShape](node=byZoneType_2.accepted, index=code_block_5)  # Filters by all the I and C section shapes.

# group: Filters the input elements based on the orientation to each other (this filters out only the connection nodes where the rafter flange is resting on top of the column) and based on the slope angle of the rafter input element.
code_block_6 = CodeBlock { 0; 1; "y"; 0; 1; }
byAngleBetweenAxes = AdvanceSteel.ConnectionAutomation.Nodes.Filter.ByAngleBetweenAxes(node=byIOrCSectionShape, indexFirst=code_block_6.out0, indexSecond=code_block_6.out1, axisFirst=code_block_6.out2, axisSecond=code_block_6.out2, rangeStart=code_block_6.out3, rangeEnd=code_block_6.out4)
code_block_7 = CodeBlock { 0; }
rafter_s_slope_range_start_from = DoubleInput(0)  # graph input
rafter_s_slope_range_end_to = DoubleInput(90)  # graph input
bySlopeAngle = AdvanceSteel.ConnectionAutomation.Nodes.Filter.BySlopeAngle(node=byAngleBetweenAxes.accepted, index=code_block_7, rangeStart=rafter_s_slope_range_start_from, rangeEnd=rafter_s_slope_range_end_to)
code_block_8 = CodeBlock { 0; 1; "y"; 89; 90; }
byAngleBetweenAxes_2 = AdvanceSteel.ConnectionAutomation.Nodes.Filter.ByAngleBetweenAxes(node=byAngleBetweenAxes.rejected, indexFirst=code_block_8.out0, indexSecond=code_block_8.out1, axisFirst=code_block_8.out2, axisSecond=code_block_8.out2, rangeStart=code_block_8.out3, rangeEnd=code_block_8.out4)
code_block_9 = CodeBlock { 0; }
bySlopeAngle_2 = AdvanceSteel.ConnectionAutomation.Nodes.Filter.BySlopeAngle(node=byAngleBetweenAxes_2.accepted, index=code_block_9, rangeStart=rafter_s_slope_range_start_from, rangeEnd=rafter_s_slope_range_end_to)
list_create = List.Create(item0=bySlopeAngle.accepted, item1=bySlopeAngle_2.accepted)

# group: Filters the input elements based on Section Type.
code_block_10 = CodeBlock { 0; }
rafter_s_section_type = StructuralDataTypes("Any | Any")  # graph input
bySectionType = AdvanceSteel.ConnectionAutomation.Nodes.Filter.BySectionType(node=list_create, index=code_block_10, nameToFind=rafter_s_section_type.typeName)
code_block_11 = CodeBlock { 1; }
column_s_section_type = StructuralDataTypes("Any | Any")  # graph input
bySectionType_2 = AdvanceSteel.ConnectionAutomation.Nodes.Filter.BySectionType(node=bySectionType.accepted, index=code_block_11, nameToFind=column_s_section_type.typeName)

# group: Creates a Gable Wall End Plate connection, ordering input elements by their indexes.
code_block_12 = CodeBlock { [0,1]; }
connection_type_to_add_in_model = ConnectionTypes()  # nothing selected; graph input
byType = AdvanceSteel.ConnectionAutomation.Nodes.Connection.ByType(node=bySectionType_2.accepted, indexes=code_block_12, connectionType=connection_type_to_add_in_model)

# group: Displays the number of created connections per run.
code_block_13 = CodeBlock { false; }
clean = List.Clean(list=byType.Connection, preserveIndices=code_block_13)
flatten = List.Flatten(list=clean)
count = List.Count(list=flatten)
number_of_created_connections = Watch(count)  # graph output

# group: Displays the number of connection nodes where connections already existed.
code_block_14 = CodeBlock { false; }
clean_2 = List.Clean(list=byType.Existing, preserveIndices=code_block_14)
flatten_2 = List.Flatten(list=clean_2)
count_2 = List.Count(list=flatten_2)
number_of_existing_connections = Watch(count_2)  # graph output
