# Dynamo graph Gusset Plate at 1 Diagonal.dyn (Dynamo 2.2.1.5175)

# group: Selects the input elements, structures them into connection nodes and takes sub nodes of 2 elements.
select_steel_elements = SelectStructureData()  # nothing selected; graph input
fromStructure = AdvanceSteel.ConnectionAutomation.Nodes.ConnectionNode.FromStructure(objects=select_steel_elements)
code_block = CodeBlock { 2; }
subNodesOfSize = AdvanceSteel.ConnectionAutomation.Nodes.ConnectionNode.SubNodesOfSize(node=fromStructure, noOfZones=code_block)

# group: Filters the input elements where the second element enters the connection with the "end" of the element.
code_block_2 = CodeBlock { 1; "End"; }
byZoneType = AdvanceSteel.ConnectionAutomation.Nodes.Filter.ByZoneType(node=subNodesOfSize, index=code_block_2.out0, zoneType=code_block_2.out1)

# group: Filters the diagonals based on section shapes such as angle, channel and hollow.
code_block_3 = CodeBlock { 1; }
byBracingSectionShapes = Custom[Filter.ByBracingSectionShapes](node=byZoneType.accepted, index=code_block_3)  # Filters by the section shapes of the diagonals in a gusset connection: angle, channel, or hollow section.

# group: Filters the input elements for the main element based on the slope angle and based on the angle between the axes of the main and secondary input elements.
code_block_4 = CodeBlock { 0; }
main_beam_slope_angle_range_from = DoubleInput(0)  # graph input
main_beam_slope_angle_range_to = DoubleInput(90)  # graph input
bySlopeAngle = AdvanceSteel.ConnectionAutomation.Nodes.Filter.BySlopeAngle(node=byBracingSectionShapes.accepted, index=code_block_4, rangeStart=main_beam_slope_angle_range_from, rangeEnd=main_beam_slope_angle_range_to)
code_block_5 = CodeBlock { 0; 1; }
angle_between_elements_range = DoubleInput(0)  # "Angle between elements range from"; graph input
angle_between_elements_range_to = DoubleInput(180)  # graph input
byAngleBetweenBeams = AdvanceSteel.ConnectionAutomation.Nodes.Filter.ByAngleBetweenBeams(node=bySlopeAngle.accepted, indexFirst=code_block_5.out0, indexSecond=code_block_5.out1, rangeStart=angle_between_elements_range, rangeEnd=angle_between_elements_range_to)

# group: Filters the input elements based on Section Type.
code_block_6 = CodeBlock { 0; }
main_beam_s_section_type = StructuralDataTypes("Any | Any")  # graph input
bySectionType = AdvanceSteel.ConnectionAutomation.Nodes.Filter.BySectionType(node=byAngleBetweenBeams.accepted, index=code_block_6, nameToFind=main_beam_s_section_type.typeName)
code_block_7 = CodeBlock { 1; }
diagonal_s_section_type = StructuralDataTypes("Any | Any")  # graph input
bySectionType_2 = AdvanceSteel.ConnectionAutomation.Nodes.Filter.BySectionType(node=bySectionType.accepted, index=code_block_7, nameToFind=diagonal_s_section_type.typeName)

# group: Creates a Gusset Plate at 1 Diagonal connection, ordering input elements by their indexes.
code_block_8 = CodeBlock { [0,1]; }
connection_type_to_add_in_model = ConnectionTypes()  # nothing selected; graph input
byType = AdvanceSteel.ConnectionAutomation.Nodes.Connection.ByType(node=bySectionType_2.accepted, indexes=code_block_8, connectionType=connection_type_to_add_in_model)

# group: Displays the number of created connections per run.
code_block_9 = CodeBlock { false; }
clean = List.Clean(list=byType.Connection, preserveIndices=code_block_9)
flatten = List.Flatten(list=clean)
count = List.Count(list=flatten)
number_of_created_connections = Watch(count)  # graph output

# group: Displays the number of connection nodes where connections already existed.
code_block_10 = CodeBlock { false; }
clean_2 = List.Clean(list=byType.Existing, preserveIndices=code_block_10)
flatten_2 = List.Flatten(list=clean_2)
count_2 = List.Count(list=flatten_2)
number_of_existing_connections = Watch(count_2)  # graph output
