# Dynamo graph Moment connection - beam to column.dyn (Dynamo 2.1.0.7500)

# group: Selects the input elements, structures them into connection nodes and takes sub nodes of 2 elements.
select_steel_elements = SelectStructureData()  # nothing selected; graph input
fromStructure = AdvanceSteel.ConnectionAutomation.Nodes.ConnectionNode.FromStructure(objects=select_steel_elements)
code_block = CodeBlock { 2; }
subNodesOfSize = AdvanceSteel.ConnectionAutomation.Nodes.ConnectionNode.SubNodesOfSize(node=fromStructure, noOfZones=code_block)

# group: Filters the input elements where the main input element enters the connection with the "Body" zone and the second element enters the connection with the "end" zone of element.
code_block_2 = CodeBlock { 0; "Body"; }
byZoneType = AdvanceSteel.ConnectionAutomation.Nodes.Filter.ByZoneType(node=subNodesOfSize, index=code_block_2.out0, zoneType=code_block_2.out1)
code_block_3 = CodeBlock { 1; "End"; }
byZoneType_2 = AdvanceSteel.ConnectionAutomation.Nodes.Filter.ByZoneType(node=byZoneType.accepted, index=code_block_3.out0, zoneType=code_block_3.out1)

# group: Filters elements where the slant angle of the main element and the slope angle of the second element are 0 degrees. For a slant angle ranging between 0 and 0 degrees, the input element is vertical. By increasing the range, the filter identifies slanted elements as well. When the slant angle ranges between 90 and 90 degrees, the filtered element is horizontal. For the slope angle ranging between 0 and 0 degrees, the input element is horizontal. By increasing the range, the filter identifies sloped elements as well. When the slope angle ranges between 90 and 90 degrees, the filtered element is vertical.
code_block_4 = CodeBlock { 0; }
main_input_slant_angle_range = DoubleInput(0)  # "Main input slant angle. Range starts from"; graph input
main_input_slant_angle_range_2 = DoubleInput(0)  # "Main input slant angle. Range ends to"; graph input
bySlantAngle = AdvanceSteel.ConnectionAutomation.Nodes.Filter.BySlantAngle(node=byZoneType_2.accepted, index=code_block_4, rangeStart=main_input_slant_angle_range, rangeEnd=main_input_slant_angle_range_2)
code_block_5 = CodeBlock { 1; }
second_input_slope_angle_range = DoubleInput(0)  # "Second input slope angle. Range starts from"; graph input
second_input_slope_angle_range_2 = DoubleInput(0)  # "Second input slope angle. Range ends to"; graph input
bySlopeAngle = AdvanceSteel.ConnectionAutomation.Nodes.Filter.BySlopeAngle(node=bySlantAngle.accepted, index=code_block_5, rangeStart=second_input_slope_angle_range, rangeEnd=second_input_slope_angle_range_2)

# group: Filters the input elements based on Section Type.
code_block_6 = CodeBlock { 0; }
main_input_family_type = StructuralDataTypes("Any | Any")  # graph input
bySectionType = AdvanceSteel.ConnectionAutomation.Nodes.Filter.BySectionType(node=bySlopeAngle.accepted, index=code_block_6, nameToFind=main_input_family_type.typeName)
code_block_7 = CodeBlock { 1; }
second_element_family_type = StructuralDataTypes("Any | Any")  # graph input
bySectionType_2 = AdvanceSteel.ConnectionAutomation.Nodes.Filter.BySectionType(node=bySectionType.accepted, index=code_block_7, nameToFind=second_element_family_type.typeName)

# group: Filters the input elements based on the angle between the axes of the main and secondary elements.
code_block_8 = CodeBlock { 0; 1; }
angle_between_1st_and_2nd = DoubleInput(0)  # "Angle between 1st and 2nd element. Range start from"; graph input
angle_between_1st_and_2nd_2 = DoubleInput(90)  # "Angle between 1st and 2nd element. Range end to"; graph input
byAngleBetweenBeams = AdvanceSteel.ConnectionAutomation.Nodes.Filter.ByAngleBetweenBeams(node=bySectionType_2.accepted, indexFirst=code_block_8.out0, indexSecond=code_block_8.out1, rangeStart=angle_between_1st_and_2nd, rangeEnd=angle_between_1st_and_2nd_2)

# group: Creates a Moment End Plate connection, ordering input elements by their indexes.
code_block_9 = CodeBlock { [0,1]; }
connection_type_to_add_in_model = ConnectionTypes()  # nothing selected; graph input
byType = AdvanceSteel.ConnectionAutomation.Nodes.Connection.ByType(node=byAngleBetweenBeams.accepted, indexes=code_block_9, connectionType=connection_type_to_add_in_model)

# group: Displays the number of created connections per run.
code_block_10 = CodeBlock { false; }
clean = List.Clean(list=byType.Connection, preserveIndices=code_block_10)
flatten = List.Flatten(list=clean)
count = List.Count(list=flatten)
number_of_created_connections = Watch(count)  # graph output

# group: Displays the number of connection nodes where connections already existed.
code_block_11 = CodeBlock { false; }
clean_2 = List.Clean(list=byType.Existing, preserveIndices=code_block_11)
flatten_2 = List.Flatten(list=clean_2)
count_2 = List.Count(list=flatten_2)
number_of_existing_connections = Watch(count_2)  # graph output
