# Dynamo graph Platform connection - beam to beam.dyn (Dynamo 2.1.0.7500)

# group: Selects the input elements, structures them into connection nodes and takes sub nodes of 2 elements.
select_steel_elements = SelectStructureData()  # nothing selected; graph input
fromStructure = AdvanceSteel.ConnectionAutomation.Nodes.ConnectionNode.FromStructure(objects=select_steel_elements)
code_block = CodeBlock { 2; }
subNodesOfSize = AdvanceSteel.ConnectionAutomation.Nodes.ConnectionNode.SubNodesOfSize(node=fromStructure, noOfZones=code_block)

# group: Filters the input elements where the secondary element enters the connection with the "end" of the element.
code_block_2 = CodeBlock { 1; "End"; }
byZoneType = AdvanceSteel.ConnectionAutomation.Nodes.Filter.ByZoneType(node=subNodesOfSize, index=code_block_2.out0, zoneType=code_block_2.out1)

# group: Filters the input elements by Section Type.
code_block_3 = CodeBlock { 0; }
main_element_family_type = StructuralDataTypes("Any | Any")  # graph input
bySectionType = AdvanceSteel.ConnectionAutomation.Nodes.Filter.BySectionType(node=byZoneType.accepted, index=code_block_3, nameToFind=main_element_family_type.typeName)
code_block_4 = CodeBlock { 1; }
second_element_family_type = StructuralDataTypes("Any | Any")  # graph input
bySectionType_2 = AdvanceSteel.ConnectionAutomation.Nodes.Filter.BySectionType(node=bySectionType.accepted, index=code_block_4, nameToFind=second_element_family_type.typeName)

# group: Filters the input elements based on the slope angles for the main and for the secondary input elements. When the slope angle range is between 0 and 0 degrees, the filtered input elements are horizontal.
code_block_5 = CodeBlock { 0; }
main_element_slope_angle_range = DoubleInput(0)  # "Main element slope angle. Range start from"; graph input
main_element_slope_angle_range_2 = DoubleInput(0)  # "Main element slope angle. Range end to"; graph input
bySlopeAngle = AdvanceSteel.ConnectionAutomation.Nodes.Filter.BySlopeAngle(node=bySectionType_2.accepted, index=code_block_5, rangeStart=main_element_slope_angle_range, rangeEnd=main_element_slope_angle_range_2)
code_block_6 = CodeBlock { 1; }
second_element_slope_angle_range = DoubleInput(0)  # "Second element slope angle. Range start from"; graph input
second_element_slope_angle_range_2 = DoubleInput(0)  # "Second element slope angle. Range end to"; graph input
bySlopeAngle_2 = AdvanceSteel.ConnectionAutomation.Nodes.Filter.BySlopeAngle(node=bySlopeAngle.accepted, index=code_block_6, rangeStart=second_element_slope_angle_range, rangeEnd=second_element_slope_angle_range_2)

# group: Filters the input elements based on the angle between the axes of the main and secondary elements.
code_block_7 = CodeBlock { 0; 1; }
angle_between_1st_and_2nd = DoubleInput(0)  # "Angle between 1st and 2nd element. Range start from"; graph input
angle_between_1st_and_2nd_2 = DoubleInput(90)  # "Angle between 1st and 2nd element. Range end to"; graph input
byAngleBetweenBeams = AdvanceSteel.ConnectionAutomation.Nodes.Filter.ByAngleBetweenBeams(node=bySlopeAngle_2.accepted, indexFirst=code_block_7.out0, indexSecond=code_block_7.out1, rangeStart=angle_between_1st_and_2nd, rangeEnd=angle_between_1st_and_2nd_2)

# group: Eliminates duplicate connection nodes, for example [BeamA, BeamB] and [BeamB, BeamA].
removeDuplicates = AdvanceSteel.ConnectionAutomation.Nodes.ConnectionNode.RemoveDuplicates(nodes=byAngleBetweenBeams.accepted)

# group: Creates a Moment end Plate connection, ordering input elements by their indexes.
code_block_8 = CodeBlock { [0,1]; }
connection_type_to_add_in_model = ConnectionTypes()  # nothing selected; graph input
byType = AdvanceSteel.ConnectionAutomation.Nodes.Connection.ByType(node=removeDuplicates, indexes=code_block_8, connectionType=connection_type_to_add_in_model)

# group: Displays the number of created connections per run.
code_block_9 = CodeBlock { false; }
clean = List.Clean(list=byType.Connection, preserveIndices=code_block_9)
flatten = List.Flatten(list=clean)
count = List.Count(list=flatten)
number_of_created_connections = Watch(count)  # graph output

# group: Displays the number of connection nodes where connections already existed.
code_block_10 = CodeBlock { false; }
clean_2 = List.Clean(list=byType.Existing, preserveIndices=code_block_10)
flatten_2 = List.Flatten(list=clean_2)
count_2 = List.Count(list=flatten_2)
number_of_existing_connections = Watch(count_2)  # graph output
