# Dynamo graph Single tube brace.dyn (Dynamo 2.2.1.5175)

# group: Selects the input elements, structures them into connection nodes and takes sub nodes of 2 elements.
select_steel_elements = SelectStructureData()  # nothing selected; graph input
fromStructure = AdvanceSteel.ConnectionAutomation.Nodes.ConnectionNode.FromStructure(objects=select_steel_elements)
code_block = CodeBlock { 2; }
subnodesOfSize = AdvanceSteel.ConnectionAutomation.Nodes.ConnectionNode.SubNodesOfSize(node=fromStructure, noOfZones=code_block)

# group: Filters the input elements where the main input element enters the connection with the "body" of the element and the second element enters the connection with the "end" of the element.
code_block_2 = CodeBlock { 0; "Body"; }
byZoneType = AdvanceSteel.ConnectionAutomation.Nodes.Filter.ByZoneType(node=subnodesOfSize, index=code_block_2.out0, zoneType=code_block_2.out1)
code_block_3 = CodeBlock { 1; "End"; }
byZoneType_2 = AdvanceSteel.ConnectionAutomation.Nodes.Filter.ByZoneType(node=byZoneType.accepted, index=code_block_3.out0, zoneType=code_block_3.out1)

# group: Filters the input elements based on the angle between the axes of the main and the secondary input elements.
code_block_4 = CodeBlock { 0; 1; "x"; }
angle_between_first_and_second = DoubleInput(0)  # "Angle between first and second element. Range start from"; graph input
angle_between_1st_and_2nd = DoubleInput(90)  # "Angle between 1st and 2nd element. range end to"; graph input
byAngleBetweenAxes = AdvanceSteel.ConnectionAutomation.Nodes.Filter.ByAngleBetweenAxes(node=byZoneType_2.accepted, indexFirst=code_block_4.out0, indexSecond=code_block_4.out1, axisFirst=code_block_4.out2, axisSecond=code_block_4.out2, rangeStart=angle_between_first_and_second, rangeEnd=angle_between_1st_and_2nd)

# group: Filters the diagonal section shape after tubular sections.
code_block_5 = CodeBlock { 1; }
byTubularSection = Custom[Filter.ByTubularSection](node=byAngleBetweenAxes.accepted, index=code_block_5)  # Filters by rectangular and circular hollow section shapes.

# group: Filters the input elements based on Section Type.
code_block_6 = CodeBlock { 0; }
main_beam_s_section_type = StructuralDataTypes("Any | Any")  # graph input
bySectionType = AdvanceSteel.ConnectionAutomation.Nodes.Filter.BySectionType(node=byTubularSection.accepted, index=code_block_6, nameToFind=main_beam_s_section_type.typeName)
code_block_7 = CodeBlock { 1; }
diagonal_s_section_type = StructuralDataTypes("Any | Any")  # graph input
bySectionType_2 = AdvanceSteel.ConnectionAutomation.Nodes.Filter.BySectionType(node=bySectionType.accepted, index=code_block_7, nameToFind=diagonal_s_section_type.typeName)

# group: Creates a Single Tube Brace Guseet at 1 Diagonal connection, ordering input elements by their indexes.
code_block_8 = CodeBlock { [0,1]; }
connection_type_to_add_in_model = ConnectionTypes()  # nothing selected; graph input
byType = AdvanceSteel.ConnectionAutomation.Nodes.Connection.ByType(node=bySectionType_2.accepted, indexes=code_block_8, connectionType=connection_type_to_add_in_model)

# group: Displays the number of created connections per run.
code_block_9 = CodeBlock { false; }
clean = List.Clean(list=byType.Connection, preserveIndices=code_block_9)
flatten = List.Flatten(list=clean)
count = List.Count(list=flatten)
number_of_created_connections = Watch(count)  # graph output

# group: Displays the number of connection nodes where connections already existed.
code_block_10 = CodeBlock { false; }
clean_2 = List.Clean(list=byType.Existing, preserveIndices=code_block_10)
flatten_2 = List.Flatten(list=clean_2)
count_2 = List.Count(list=flatten_2)
number_of_existing_connections = Watch(count_2)  # graph output
