# Dynamo graph Splice Joint.dyn (Dynamo 2.1.0.7500)

# group: Selects the input elements, structures them into connection nodes and takes sub nodes of 2 elements.
select_steel_elements = SelectStructureData()  # nothing selected; graph input
fromStructure = AdvanceSteel.ConnectionAutomation.Nodes.ConnectionNode.FromStructure(objects=select_steel_elements)
code_block = CodeBlock { 2; }
subNodesOfSize = AdvanceSteel.ConnectionAutomation.Nodes.ConnectionNode.SubNodesOfSize(node=fromStructure, noOfZones=code_block)

# group: Defines the zones for which the elements are joining each other to create a connection.
code_block_2 = CodeBlock { 0; "End"; }
byZoneType = AdvanceSteel.ConnectionAutomation.Nodes.Filter.ByZoneType(node=subNodesOfSize, index=code_block_2.out0, zoneType=code_block_2.out1)
code_block_3 = CodeBlock { 1; "End"; }
byZoneType_2 = AdvanceSteel.ConnectionAutomation.Nodes.Filter.ByZoneType(node=byZoneType.accepted, index=code_block_3.out0, zoneType=code_block_3.out1)

# group: Filters the input elements based on slant angle. When the slant angle ranges between 0 and 0 degrees, the filter includes only vertical input elements. When the range increases the filter includes slanted elements. When the range is between 90 and 90 degrees then the filter will include horizontal elements.
code_block_4 = CodeBlock { 0; 1; }
input_elements_slant_angle_range = DoubleInput(0)  # "Input elements slant angle. Range starts from"; graph input
input_elements_slant_angle_range_2 = DoubleInput(0)  # "Input elements slant angle. Range ends to"; graph input
bySlantAngle = AdvanceSteel.ConnectionAutomation.Nodes.Filter.BySlantAngle(node=byZoneType_2.accepted, index=code_block_4.out0, rangeStart=input_elements_slant_angle_range, rangeEnd=input_elements_slant_angle_range_2)
bySlantAngle_2 = AdvanceSteel.ConnectionAutomation.Nodes.Filter.BySlantAngle(node=bySlantAngle.accepted, index=code_block_4.out1, rangeStart=input_elements_slant_angle_range, rangeEnd=input_elements_slant_angle_range_2)

# group: Filters the input elements based on the angle between beams, to identify where the main and the secondary input elements are parallel and that they have the same orientation toward each other. This is a required condition for the Splice joint connection.
code_block_5 = CodeBlock { 0; 1; 180; 180; }
byAngleBetweenBeams = AdvanceSteel.ConnectionAutomation.Nodes.Filter.ByAngleBetweenBeams(node=bySlantAngle_2.accepted, indexFirst=code_block_5.out0, indexSecond=code_block_5.out1, rangeStart=code_block_5.out2, rangeEnd=code_block_5.out3)
code_block_6 = CodeBlock { 0; 1; "Y"; "Y"; 0; 0; }
byAngleBetweenAxes = AdvanceSteel.ConnectionAutomation.Nodes.Filter.ByAngleBetweenAxes(node=byAngleBetweenBeams.accepted, indexFirst=code_block_6.out0, indexSecond=code_block_6.out1, axisFirst=code_block_6.out2, axisSecond=code_block_6.out3, rangeStart=code_block_6.out4, rangeEnd=code_block_6.out5)

# group: Filters the input elements based on the type name for the main and secondary elements.
code_block_7 = CodeBlock { 0; }
type_for_main_input_element = StructuralDataTypes("Any | Any")  # graph input
bySectionType = AdvanceSteel.ConnectionAutomation.Nodes.Filter.BySectionType(node=byAngleBetweenAxes.accepted, index=code_block_7, nameToFind=type_for_main_input_element.typeName)
code_block_8 = CodeBlock { 1; }
type_for_second_input_element = StructuralDataTypes("Any | Any")  # graph input
bySectionType_2 = AdvanceSteel.ConnectionAutomation.Nodes.Filter.BySectionType(node=bySectionType.accepted, index=code_block_8, nameToFind=type_for_second_input_element.typeName)

# group: Eliminates duplicate connection nodes, such as [BeamA, BeamB] and [BeamB, BeamA].
removeDuplicates = AdvanceSteel.ConnectionAutomation.Nodes.ConnectionNode.RemoveDuplicates(nodes=bySectionType_2.accepted)

# group: Creates a Splice Joint connection, ordering input elements by their indexes.
code_block_9 = CodeBlock { [0,1]; }
connection_type_to_add_in_model = ConnectionTypes()  # nothing selected; graph input
byType = AdvanceSteel.ConnectionAutomation.Nodes.Connection.ByType(node=removeDuplicates, indexes=code_block_9, connectionType=connection_type_to_add_in_model)

# group: Displays the number of created connections per run.
code_block_10 = CodeBlock { false; }
clean = List.Clean(list=byType.Connection, preserveIndices=code_block_10)
flatten = List.Flatten(list=clean)
count = List.Count(list=flatten)
number_of_created_connections = Watch(count)  # graph output

# group: Displays the number of connection nodes where connections already existed.
code_block_11 = CodeBlock { false; }
clean_2 = List.Clean(list=byType.Existing, preserveIndices=code_block_11)
flatten_2 = List.Flatten(list=clean_2)
count_2 = List.Count(list=flatten_2)
number_of_existing_connections = Watch(count_2)  # graph output
