# Dynamo graph Triple brace by ranges.dyn (Dynamo 2.8.0.2195)

string = StringInput("Rundown:\n")
select_steel_elements = SelectStructureData()  # nothing selected; graph input
fromStructure = AdvanceSteel.ConnectionAutomation.Nodes.ConnectionNode.FromStructure(objects=select_steel_elements)
code_block = CodeBlock { 4; }
subNodesOfSize = AdvanceSteel.ConnectionAutomation.Nodes.ConnectionNode.SubNodesOfSize(node=fromStructure, noOfZones=code_block)

# group: Geometric conditions
code_block_2 = CodeBlock { 1; }
byZoneType = AdvanceSteel.ConnectionAutomation.Nodes.Filter.ByZoneType(node=subNodesOfSize, index=code_block_2)
code_block_3 = CodeBlock { 2; }
byZoneType_2 = AdvanceSteel.ConnectionAutomation.Nodes.Filter.ByZoneType(node=byZoneType.accepted, index=code_block_3)
code_block_4 = CodeBlock { 0; }
main_beam_slope_angle_degrees = DoubleInput(0)  # "Main Beam Slope Angle (degrees) from"
main_beam_slope_angle_degrees_to = DoubleInput(0)
bySlopeAngle = AdvanceSteel.ConnectionAutomation.Nodes.Filter.BySlopeAngle(node=byZoneType_2.accepted, index=code_block_4, rangeStart=main_beam_slope_angle_degrees, rangeEnd=main_beam_slope_angle_degrees_to)
code_block_5 = CodeBlock { 1; 2; 3; }
first_and_last_secondary_beams = DoubleInput(20)  # "First and last secondary beams Slope/ Tilt Angle (degrees) from"; graph input
first_and_last_secondary_beams_2 = DoubleInput(70)  # "First and last secondary beams Slope/ Tilt Angle (degrees) to"; graph input
bySlopeAngle_2 = AdvanceSteel.ConnectionAutomation.Nodes.Filter.BySlopeAngle(node=bySlopeAngle.accepted, index=code_block_5.out0, rangeStart=first_and_last_secondary_beams, rangeEnd=first_and_last_secondary_beams_2)
code_block_6 = CodeBlock { 0; }
bySlantAngle = AdvanceSteel.ConnectionAutomation.Nodes.Filter.BySlantAngle(node=bySlopeAngle_2.accepted, index=code_block_5.out1, rangeStart=code_block_6, rangeEnd=first_and_last_secondary_beams)
bySlopeAngle_3 = AdvanceSteel.ConnectionAutomation.Nodes.Filter.BySlopeAngle(node=bySlantAngle.accepted, index=code_block_5.out2, rangeStart=first_and_last_secondary_beams, rangeEnd=first_and_last_secondary_beams_2)

# group: Additional (optional) filtering: by section types
code_block_7 = CodeBlock { 0; }
main_beam_section_type = StructuralDataTypes("Any | Any")
bySectionType = AdvanceSteel.ConnectionAutomation.Nodes.Filter.BySectionType(node=bySlopeAngle_3.accepted, index=code_block_7, nameToFind=main_beam_section_type.typeName)
code_block_8 = CodeBlock { 1; 2; 3; }
section_type_for_secondary_beams = StructuralDataTypes("Any | Any")
bySectionType_2 = AdvanceSteel.ConnectionAutomation.Nodes.Filter.BySectionType(node=bySectionType.accepted, index=code_block_8.out0, nameToFind=section_type_for_secondary_beams.typeName)
bySectionType_3 = AdvanceSteel.ConnectionAutomation.Nodes.Filter.BySectionType(node=bySectionType_2.accepted, index=code_block_8.out1, nameToFind=section_type_for_secondary_beams.typeName)
bySectionType_4 = AdvanceSteel.ConnectionAutomation.Nodes.Filter.BySectionType(node=bySectionType_3.accepted, index=code_block_8.out2, nameToFind=section_type_for_secondary_beams.typeName)

removeDuplicates = AdvanceSteel.ConnectionAutomation.Nodes.ConnectionNode.RemoveDuplicates(nodes=bySectionType_4.accepted)
code_block_9 = CodeBlock { false; }
clean = List.Clean(list=removeDuplicates, preserveIndices=code_block_9)
code_block_10 = CodeBlock { [0,1,2,3]; }
connection_family_to_place = StringInput("Triple tube brace angle")  # graph input

# group: Get the connection types from the library
library_file_path = Filename(".\Connection library with ranges of applicability.rvt")  # graph input
byName = AdvanceSteel.ConnectionAutomation.Nodes.ConnectionType.ByName(connectionName=connection_family_to_place, filePath=library_file_path)
proper_list_or_empty = CodeBlock(x=byName) { List.Flatten(List.Clean([x], false)); }

# group: Get the connection types loaded current model
code_block_11 = CodeBlock { null; }
byName_2 = AdvanceSteel.ConnectionAutomation.Nodes.ConnectionType.ByName(connectionName=connection_family_to_place, filePath=code_block_11)
proper_list_or_empty_2 = CodeBlock(x=byName_2) { List.Flatten(List.Clean([x], false)); }

# group: Combine, with those in model taking precedence
code_block_12 = CodeBlock(x=proper_list_or_empty) { x.ConnectionName + "|" + x.TypeName; }
byKeysValues = DesignScript.Builtin.Dictionary.ByKeysValues(keys=code_block_12, values=proper_list_or_empty)
code_block_13 = CodeBlock(x=proper_list_or_empty_2) { x.ConnectionName + "|" + x.TypeName; }
setValueAtKeys = DesignScript.Builtin.Dictionary.SetValueAtKeys(dictionary=byKeysValues, keys=code_block_13, values=proper_list_or_empty_2)
values = DesignScript.Builtin.Dictionary.Values(dictionary=setValueAtKeys)

# group: Order Connection Types by name
code_block_14 = CodeBlock(x=values) { x.ConnectionName + "|" + x.TypeName; }
sortByKey = List.SortByKey(list=values, keys=code_block_14)

# group: Filter Connection Types by name
typeName = AdvanceSteel.ConnectionAutomation.Nodes.ConnectionType.TypeName(connectionType=sortByKey.sorted_list)
only_connection_types_whose = StringInput("")  # "Only connection types whose names contain these words (leave empty for all)"; graph input
code_block_15 = CodeBlock { [" ", "\r\n", "\r", "\n", "\t"]; }
split = String.Split(str=only_connection_types_whose, separator0=code_block_15)
contains = String.Contains(str=typeName@L1, searchFor=split)
allTrue = List.AllTrue(list=contains@L2)
filterByBoolMask = List.FilterByBoolMask(list=sortByKey.sorted_list, mask=allTrue)

select_analysis_results = AnalysisResults("Revit Member End Forces")  # graph input
matchTypeByRanges = AdvanceSteel.ConnectionAutomation.Nodes.ConnectionNode.MatchTypeByRanges(node=clean, indexes=code_block_10, connectionTypes=filterByBoolMask.in, analysisResult=select_analysis_results)

# group: Separate into ConnectionNodes and their respective List of ConnectionTypes
code_block_16 = CodeBlock { false; }
clean_2 = List.Clean(list=matchTypeByRanges.accepted, preserveIndices=code_block_16)
lastItem = List.LastItem(list=clean_2@L3)
firstItem = List.FirstItem(list=clean_2@L3)

firstItem_2 = List.FirstItem(list=lastItem@L2)

# group: Count applicable connections by type
code_block_17 = CodeBlock { false; }
clean_3 = List.Clean(list=firstItem_2, preserveIndices=code_block_17)
typeName_2 = AdvanceSteel.ConnectionAutomation.Nodes.ConnectionType.TypeName(connectionType=clean_3)
groupByKey = List.GroupByKey(list=typeName_2, keys=typeName_2)
count = List.Count(list=groupByKey.groups@L2)
string_from_object = FromObject(obj=count)

string_2 = StringInput("{type_text}: {created_number} created, of {applicable_number} applicable")
string_3 = StringInput("{created_number}")
byType = AdvanceSteel.ConnectionAutomation.Nodes.Connection.ByType(node=firstItem, indexes=code_block_10, connectionType=firstItem_2)

# group: Count created connections by type
code_block_18 = CodeBlock { false; }
clean_4 = List.Clean(list=byType.Connection, preserveIndices=code_block_18)
connectionType = AdvanceSteel.ConnectionAutomation.Nodes.Connection.ConnectionType(connection=clean_4)
typeName_3 = AdvanceSteel.ConnectionAutomation.Nodes.ConnectionType.TypeName(connectionType=connectionType)
eq = typeName_3 == groupByKey.unique_keys@@L1
countTrue = List.CountTrue(list=eq@L2)
string_from_object_2 = FromObject(obj=countTrue)

replace = String.Replace(str=string_2, searchFor=string_3, replaceWith=string_from_object_2)
string_4 = StringInput("{applicable_number}")
replace_2 = String.Replace(str=replace, searchFor=string_4, replaceWith=string_from_object)
string_5 = StringInput("{type_text}")
replace_3 = String.Replace(str=replace_2, searchFor=string_5, replaceWith=groupByKey.unique_keys)

# group: Combine lines
count_2 = List.Count(list=groupByKey.unique_keys)
code_block_19 = CodeBlock { 0; }
gt = count_2 > code_block_19
code_block_20 = CodeBlock { "\n"; }
join = String.Join(separator=code_block_20)  # unwired: string0, string1
code_block_21 = CodeBlock { ""; }
reduce = List.Reduce(reductor=join, seed=code_block_21, list1=replace_3)
string_6 = StringInput("No connection type was applicable anywhere. Make sure your connection types have ranges defined.")
if_ = If(test=gt, true=reduce, false=string_6)

string_7 = StringInput("\n\nTotal: {created_number} created, {existing_number} existed, from {applicable_number} applicable, out of {situations_number} potential situations.")
string_8 = StringInput("{created_number}")

# group: Count total created connections
code_block_22 = CodeBlock { false; }
clean_5 = List.Clean(list=byType.Connection, preserveIndices=code_block_22)
flatten = List.Flatten(list=clean_5)
count_3 = List.Count(list=flatten)
string_from_object_3 = FromObject(obj=count_3)

replace_4 = String.Replace(str=string_7, searchFor=string_8, replaceWith=string_from_object_3)
string_9 = StringInput("{existing_number}")

# group: Count total connections that existed
code_block_23 = CodeBlock { false; }
clean_6 = List.Clean(list=byType.Existing, preserveIndices=code_block_23)
flatten_2 = List.Flatten(list=clean_6)
count_4 = List.Count(list=flatten_2)
string_from_object_4 = FromObject(obj=count_4)

replace_5 = String.Replace(str=replace_4, searchFor=string_9, replaceWith=string_from_object_4)
string_10 = StringInput("{applicable_number}")

# group: Count total applicable connections (according to ranges)
code_block_24 = CodeBlock { false; }
clean_7 = List.Clean(list=firstItem, preserveIndices=code_block_24)
flatten_3 = List.Flatten(list=clean_7)
count_5 = List.Count(list=flatten_3)
string_from_object_5 = FromObject(obj=count_5)

replace_6 = String.Replace(str=replace_5, searchFor=string_10, replaceWith=string_from_object_5)
string_11 = StringInput("{situations_number}")

# group: Count total potential situations (beam to column)
code_block_25 = CodeBlock { false; }
clean_8 = List.Clean(list=clean, preserveIndices=code_block_25)
flatten_4 = List.Flatten(list=clean_8)
count_6 = List.Count(list=flatten_4)
string_from_object_6 = FromObject(obj=count_6)

replace_7 = String.Replace(str=replace_6, searchFor=string_11, replaceWith=string_from_object_6)
concat = String.Concat(string0=string, string1=if_, string2=replace_7)
summary_report = Watch(concat)  # graph output
