# Dynamo graph Two beams to one beam by ranges.dyn (Dynamo 2.8.0.2195)

string = StringInput("Rundown:\n")
select_steel_elements = SelectStructureData()  # nothing selected; graph input
fromStructure = AdvanceSteel.ConnectionAutomation.Nodes.ConnectionNode.FromStructure(objects=select_steel_elements)
code_block = CodeBlock { 3; }
subNodesOfSize = AdvanceSteel.ConnectionAutomation.Nodes.ConnectionNode.SubNodesOfSize(node=fromStructure, noOfZones=code_block)

# group: Geometric conditions
code_block_2 = CodeBlock { 0; "Body"; }
byZoneType = AdvanceSteel.ConnectionAutomation.Nodes.Filter.ByZoneType(node=subNodesOfSize, index=code_block_2.out0, zoneType=code_block_2.out1)
code_block_3 = CodeBlock { 1; }
byZoneType_2 = AdvanceSteel.ConnectionAutomation.Nodes.Filter.ByZoneType(node=byZoneType.accepted, index=code_block_3)
code_block_4 = CodeBlock { 0; }
main_beam_slope_tilt_angle = DoubleInput(0)  # "Main beam Slope/ Tilt Angle (degrees) from"; graph input
main_beam_slope_tilt_angle_2 = DoubleInput(0)  # "Main beam Slope/ Tilt Angle (degrees) to"; graph input
bySlopeAngle = AdvanceSteel.ConnectionAutomation.Nodes.Filter.BySlopeAngle(node=byZoneType_2.accepted, index=code_block_4, rangeStart=main_beam_slope_tilt_angle, rangeEnd=main_beam_slope_tilt_angle_2)
code_block_5 = CodeBlock { 1; }
secondary_beams_slope_tilt_angle = DoubleInput(0)  # "Secondary beams' Slope/ Tilt Angle (degrees) from"; graph input
secondary_beams_slope_tilt_angle_2 = DoubleInput(0)  # "Secondary beams' Slope/ Tilt Angle (degrees) to"; graph input
bySlopeAngle_2 = AdvanceSteel.ConnectionAutomation.Nodes.Filter.BySlopeAngle(node=bySlopeAngle.accepted, index=code_block_5, rangeStart=secondary_beams_slope_tilt_angle, rangeEnd=secondary_beams_slope_tilt_angle_2)
code_block_6 = CodeBlock { 2; }
bySlopeAngle_3 = AdvanceSteel.ConnectionAutomation.Nodes.Filter.BySlopeAngle(node=bySlopeAngle_2.accepted, index=code_block_6, rangeStart=secondary_beams_slope_tilt_angle, rangeEnd=secondary_beams_slope_tilt_angle_2)
code_block_7 = CodeBlock { 0; 1; "X"; }
angle_between_main_and_secondary = DoubleInput(90)  # "Angle between main and secondary beams (degrees, 0-90) from"; graph input
angle_between_main_and_secondary_2 = DoubleInput(90)  # "Angle between main and secondary beams (degrees, 0-90) to"; graph input
byAngleBetweenAxes = AdvanceSteel.ConnectionAutomation.Nodes.Filter.ByAngleBetweenAxes(node=bySlopeAngle_3.accepted, indexFirst=code_block_7.out0, indexSecond=code_block_7.out1, axisFirst=code_block_7.out2, axisSecond=code_block_7.out2, rangeStart=angle_between_main_and_secondary, rangeEnd=angle_between_main_and_secondary_2)
secondary_beams_colinearity = DoubleInput(0)  # "Secondary beams colinearity tolerance (degrees)"
code_block_8 = CodeBlock(x=secondary_beams_colinearity) { 1; 2; 180-x; 180; }
byAngleBetweenBeams = AdvanceSteel.ConnectionAutomation.Nodes.Filter.ByAngleBetweenBeams(node=byAngleBetweenAxes.accepted, indexFirst=code_block_8.out0, indexSecond=code_block_8.out1, rangeStart=code_block_8.out2, rangeEnd=code_block_8.out3)

removeDuplicates = AdvanceSteel.ConnectionAutomation.Nodes.ConnectionNode.RemoveDuplicates(nodes=byAngleBetweenBeams.accepted)
code_block_9 = CodeBlock { false; }
clean = List.Clean(list=removeDuplicates, preserveIndices=code_block_9)
code_block_10 = CodeBlock { [0,1,2]; }
connection_family_to_place = StringInput("Double side clip angle")  # graph input

# group: Get the connection types from the library
library_file_path = Filename(".\Connection library with ranges of applicability.rvt")  # graph input
byName = AdvanceSteel.ConnectionAutomation.Nodes.ConnectionType.ByName(connectionName=connection_family_to_place, filePath=library_file_path)
proper_list_or_empty = CodeBlock(x=byName) { List.Flatten(List.Clean([x], false)); }

# group: Get the connection types loaded current model
code_block_11 = CodeBlock { null; }
byName_2 = AdvanceSteel.ConnectionAutomation.Nodes.ConnectionType.ByName(connectionName=connection_family_to_place, filePath=code_block_11)
proper_list_or_empty_2 = CodeBlock(x=byName_2) { List.Flatten(List.Clean([x], false)); }

# group: Combine, with those in model taking precedence
code_block_12 = CodeBlock(x=proper_list_or_empty) { x.ConnectionName + "|" + x.TypeName; }
byKeysValues = DesignScript.Builtin.Dictionary.ByKeysValues(keys=code_block_12, values=proper_list_or_empty)
code_block_13 = CodeBlock(x=proper_list_or_empty_2) { x.ConnectionName + "|" + x.TypeName; }
setValueAtKeys = DesignScript.Builtin.Dictionary.SetValueAtKeys(dictionary=byKeysValues, keys=code_block_13, values=proper_list_or_empty_2)
values = DesignScript.Builtin.Dictionary.Values(dictionary=setValueAtKeys)

# group: Order Connection Types by name
code_block_14 = CodeBlock(x=values) { x.ConnectionName + "|" + x.TypeName; }
sortByKey = List.SortByKey(list=values, keys=code_block_14)

# group: Filter Connection Types by name
typeName = AdvanceSteel.ConnectionAutomation.Nodes.ConnectionType.TypeName(connectionType=sortByKey.sorted_list)
only_connection_types_whose = StringInput("")  # "Only connection types whose names contain these words (leave empty for all)"; graph input
code_block_15 = CodeBlock { [" ", "\r\n", "\r", "\n", "\t"]; }
split = String.Split(str=only_connection_types_whose, separator0=code_block_15)
contains = String.Contains(str=typeName@L1, searchFor=split)
allTrue = List.AllTrue(list=contains@L2)
filterByBoolMask = List.FilterByBoolMask(list=sortByKey.sorted_list, mask=allTrue)

select_analysis_results = AnalysisResults("Revit Member End Forces")  # graph input
matchTypeByRanges = AdvanceSteel.ConnectionAutomation.Nodes.ConnectionNode.MatchTypeByRanges(node=clean, indexes=code_block_10, connectionTypes=filterByBoolMask.in, analysisResult=select_analysis_results)

# group: Separate into ConnectionNodes and their respective List of ConnectionTypes
code_block_16 = CodeBlock { false; }
clean_2 = List.Clean(list=matchTypeByRanges.accepted, preserveIndices=code_block_16)
lastItem = List.LastItem(list=clean_2@L3)
firstItem = List.FirstItem(list=clean_2@L3)

firstItem_2 = List.FirstItem(list=lastItem@L2)

# group: Count applicable connections by type
code_block_17 = CodeBlock { false; }
clean_3 = List.Clean(list=firstItem_2, preserveIndices=code_block_17)
typeName_2 = AdvanceSteel.ConnectionAutomation.Nodes.ConnectionType.TypeName(connectionType=clean_3)
groupByKey = List.GroupByKey(list=typeName_2, keys=typeName_2)
count = List.Count(list=groupByKey.groups@L2)
string_from_object = FromObject(obj=count)

template_for_each_row = StringInput("{type_text}: {created_number} created, from {applicable_number} applicable")
string_2 = StringInput("{created_number}")
byType = AdvanceSteel.ConnectionAutomation.Nodes.Connection.ByType(node=firstItem, indexes=code_block_10, connectionType=firstItem_2)

# group: Count created connections by type
code_block_18 = CodeBlock { false; }
clean_4 = List.Clean(list=byType.Connection, preserveIndices=code_block_18)
connectionType = AdvanceSteel.ConnectionAutomation.Nodes.Connection.ConnectionType(connection=clean_4)
typeName_3 = AdvanceSteel.ConnectionAutomation.Nodes.ConnectionType.TypeName(connectionType=connectionType)
eq = typeName_3 == groupByKey.unique_keys@@L1
countTrue = List.CountTrue(list=eq@L2)
string_from_object_2 = FromObject(obj=countTrue)

replace = String.Replace(str=template_for_each_row, searchFor=string_2, replaceWith=string_from_object_2)
string_3 = StringInput("{applicable_number}")
replace_2 = String.Replace(str=replace, searchFor=string_3, replaceWith=string_from_object)
string_4 = StringInput("{type_text}")
replace_3 = String.Replace(str=replace_2, searchFor=string_4, replaceWith=groupByKey.unique_keys)

# group: Combine lines
count_2 = List.Count(list=groupByKey.unique_keys)
code_block_19 = CodeBlock { 0; }
gt = count_2 > code_block_19
code_block_20 = CodeBlock { "\n"; }
join = String.Join(separator=code_block_20)  # unwired: string0, string1
string_5 = StringInput("")
reduce = List.Reduce(reductor=join, seed=string_5, list1=replace_3)
string_6 = StringInput("No connection type was applicable anywhere. Make sure your connection types have ranges defined.")
if_ = If(test=gt, true=reduce, false=string_6)

template_for_totals = StringInput("\n\nTotal: {created_number} created, {existing_number} existed, from {applicable_number} applicable, out of {situations_number} potential situations.")
string_7 = StringInput("{created_number}")

# group: Count total created connections
code_block_21 = CodeBlock { false; }
clean_5 = List.Clean(list=byType.Connection, preserveIndices=code_block_21)
flatten = List.Flatten(list=clean_5)
count_3 = List.Count(list=flatten)
string_from_object_3 = FromObject(obj=count_3)

replace_4 = String.Replace(str=template_for_totals, searchFor=string_7, replaceWith=string_from_object_3)
string_8 = StringInput("{existing_number}")

# group: Count total connections that existed
code_block_22 = CodeBlock { false; }
clean_6 = List.Clean(list=byType.Existing, preserveIndices=code_block_22)
flatten_2 = List.Flatten(list=clean_6)
count_4 = List.Count(list=flatten_2)
string_from_object_4 = FromObject(obj=count_4)

replace_5 = String.Replace(str=replace_4, searchFor=string_8, replaceWith=string_from_object_4)
string_9 = StringInput("{applicable_number}")

# group: Count total applicable connections (according to ranges)
code_block_23 = CodeBlock { false; }
clean_7 = List.Clean(list=firstItem, preserveIndices=code_block_23)
flatten_3 = List.Flatten(list=clean_7)
count_5 = List.Count(list=flatten_3)
string_from_object_5 = FromObject(obj=count_5)

replace_6 = String.Replace(str=replace_5, searchFor=string_9, replaceWith=string_from_object_5)
string_10 = StringInput("{situations_number}")

# group: Count total potential situations (beam to column)
code_block_24 = CodeBlock { false; }
clean_8 = List.Clean(list=clean, preserveIndices=code_block_24)
flatten_4 = List.Flatten(list=clean_8)
count_6 = List.Count(list=flatten_4)
string_from_object_6 = FromObject(obj=count_6)

replace_7 = String.Replace(str=replace_6, searchFor=string_10, replaceWith=string_from_object_6)
concat = String.Concat(string0=string, string1=if_, string2=replace_7)
summary_report = Watch(concat)  # graph output
