# Dynamo graph Add Levels Above Or Below Selected Level.dyn (Dynamo 2.13.0.3135)

# group: Add Levels
# Add Levels Above or Below Selected Level
# note: CATEGORY:
# Modeling
# DESCRIPTION:
# Create a series of levels above or below the selected level.
# MODEL PREPARATION:
# - None
# NOTE:
# - To ensure that the levels will not be deleted the
# next time you run the graph, avoid saving the graph.
# - Newly created levels will assume default 3D extents; adjust length(s) as necessary.
# - Crop Region extents may affect the visibility of newly created Levels. If a new level or levels is not visible in the active view, turn off the Crop Region.
# AUTHORS:
# - Autodesk
# Copyright (c) 2021, Autodesk
# REQUIRED PACKAGES:
# - None

# group: Selection
# User Selections
# note: Select a level to use as the starting point for the other levels.
select_a_level = Levels()  # nothing selected; graph input

# group: Spacing and Quantity
# Enter spacing for new levels and the number of levels to create. (negative distance results in levels below)
distance_from_selected_level = LengthFromString(Value=3.048)  # "Distance from Selected Level (Feet and Inches)"; graph input
number_of_new_levels_to_create = IntegerSlider(5, range=1..100 step 1)  # graph input

# group: Distance Calculation
# Compute new level spacing.
sequence = Sequence(start=distance_from_selected_level, amount=number_of_new_levels_to_create, step=distance_from_selected_level, lacing=Longest)

# group: Level Creation
# Create levels based on existing and spacing.
byLevelAndOffset = Level.ByLevelAndOffset(level=select_a_level, offset=sequence)

# group: Output
# Newly created levels
new_levels = Watch(byLevelAndOffset)  # graph output
