# Dynamo graph Add Levels(Imperial).dyn (Dynamo 2.13.0.3137)
# author: Autodesk
# Create a series of levels above or below the selected level.

# group: Create Levels
# Add Levels Above or Below Selected Level
# note: See graph properties for more information.

# group: Selection
# User Selections
# note: Select a level to use as the starting point for the other levels.
select_a_level = Levels("01 - Entry Level")  # graph input

# group: Spacing and Quantity
# Enter spacing for new levels and the number of levels to create. (negative distance results in levels below)
distance_from_selected_level = LengthFromString(Value=3.048)  # "Distance from Selected Level (Feet and Inches)"; graph input
number_of_new_levels_to_create = IntegerSlider(5, range=1..100 step 1)  # graph input

# group: Distance Calculation
# Compute new level spacing.
sequence = Sequence(start=distance_from_selected_level, amount=number_of_new_levels_to_create, step=distance_from_selected_level)

# group: Level Creation
# Create levels based on existing and spacing.
byLevelAndOffset = Level.ByLevelAndOffset(level=select_a_level, offset=sequence)

# group: Output
# Newly created levels
new_levels = Watch(byLevelAndOffset)  # graph output
