# Dynamo graph Calculate Longest Exit Distance.dyn (Dynamo 2.13.0.2751)
# author: Autodesk
# Creates a single Path of Travel from a point (on the perimeter of a room within a project) that has the longest distance to its closest exit.

# group: Path of Travel
# Calculate Longest Exit Distance
# note: See graph properties for more information

# group: Floor Plan View to Use
# Uses the active view (Must be a floor plan view) to calculate the longest exit. Note: The model must have rooms.
current = Document.Current()
activeView = Document.ActiveView(document=current)

# group: START HERE!
# Use the select buttons and select two exit doors in the Revit model. Then press Run in the lower left of the Dynamo applcation window to run the script.
select_exit_door = DSModelElementSelection()  # 1 picked in the model; graph input
select_alternate_exit_door = DSModelElementSelection()  # 1 picked in the model; graph input

# group: Exit points
# Collect list of end points at exits
list_create = List.Create(item0=select_exit_door, item1=select_alternate_exit_door)
boundingBox = Element.BoundingBox(element=list_create)
toCuboid = BoundingBox.ToCuboid(boundingBox=boundingBox)
centroid = Solid.Centroid(solid=toCuboid)

# group: Calculation
# Calculate longest path of travel for current floor plan view
longestOfShortestExitPaths = PathOfTravel.LongestOfShortestExitPaths(floorPlan=activeView, endPtsList=centroid)

# group: Path of Travel Output
# Output actual path of travel for use
longest_exit_path = Watch(longestOfShortestExitPaths)  # graph output

# group: Data Extraction
# Get parameters for output
string = StringInput("Length")
string_2 = StringInput("Time")
string_3 = StringInput("Speed")
list_create_2 = List.Create(item0=string, item1=string_2, item2=string_3)
getParameterValueByName = Element.GetParameterValueByName(element=longestOfShortestExitPaths, parameterName=list_create_2)

# group: Round
# to 3 decimal places
number = DoubleInput(3)
round = Math.Round(number=getParameterValueByName, digits=number)

# group: Number Clean Up
# Remove trailing zeroes
string_from_object = FromObject(object=round)
code_block = CodeBlock { "."; }
indexOf = String.IndexOf(string=string_from_object, searchFor=code_block)
code_block_2 = CodeBlock(decimal=indexOf) { 0; decimal + 4; }
substring = String.Substring(string=string_from_object, startIndex=code_block_2.out0, length=code_block_2.out1)

# group: Get Units
# Retrieve units from file for output.
getProjectUnits = Python()  # CPython3; unwired: IN[0]
# ---------- getProjectUnits.python (30 lines) ----------
# Import DocumentManager and TransactionManager
import clr
clr.AddReference("RevitServices")
import RevitServices
from RevitServices.Persistence import DocumentManager
doc = DocumentManager.Instance.CurrentDBDocument

# Import RevitAPI
clr.AddReference("RevitAPI")
import Autodesk
from Autodesk.Revit.DB import *

# Add reference to IronPython Lib folder
import sys
pyt_path = r'C:\Program Files (x86)\IronPython 2.7\Lib'
sys.path.append(pyt_path)

# Set up inputs
value = IN[0]

# Execute definition
projectUnits = Document.GetUnits(doc).GetFormatOptions(SpecTypeId.Length).GetUnitTypeId()
projectDisplayUnits = LabelUtils.GetLabelForUnit(projectUnits)

speedUnits = Document.GetUnits(doc).GetFormatOptions(SpecTypeId.Speed).GetUnitTypeId()
speedDisplayUnits = LabelUtils.GetLabelForUnit(speedUnits)


# Assign your output to the OUT variable
OUT = projectDisplayUnits,speedDisplayUnits
# ----------------------------------------

# group: Build Output
# combine strings and return output for Dynamo Player. By using addition in a code block we convert numbers to string automatically
code_block_3 = CodeBlock(data=substring) { totalLength = data[0]; travelTime = data[1]; speed = data[2]; }
code_block_4 = CodeBlock(data=getProjectUnits) { lengthUnits = data[0]; speedUnits = data[1]; }
code_block_5 = CodeBlock(totalLength=code_block_3.totalLength, travelTime=code_block_3.travelTime, speed=code_block_3.speed, lengthUnits=code_block_4.lengthUnits, speedUnits=code_block_4.speedUnits)
# ---------- code_block_5.designscript (10 lines) ----------
//declare a few variables to combine for output
totalLength;
travelTime;
speed;
lengthUnits;
speedUnits;
//build output
//first line prefix + count + return line
"Longest Path is: " + totalLength + " " + lengthUnits + " " + " Long\n" +
"Total Travel Time: " + travelTime + " " + "seconds @ " + speed + " " + speedUnits;
# ----------------------------------------
calculation_results = Watch(code_block_5.out5)  # graph output
