# Dynamo graph Calculate Room Occupancy Load.dyn (Dynamo 2.13.0.3135)

# group: Calculate Room Occupancy Load
# note: CATEGORY:
# Administration
# DESCRIPTION:
# This workflow will report information about the selected room and its occupancy load based on the allowable number of occupants per unit area.
# MODEL PREPARATION:
# - None
# NOTE:
#  - None
# AUTHORS:
# - Autodesk
# Copyright(c) 2017, Autodesk
# REQUIRED PACKAGES:
# - None

# group: Select Room.
select_a_room = DSModelElementSelection()  # nothing selected; graph input

# group: Check if selected object is a room.
getCategory = Element.GetCategory(element=select_a_room)
name = Category.Name(category=getCategory)
code_block = CodeBlock { "Rooms"; }
equals = List.Equals(object=name, otherObject=code_block)

# group: If selected object is a Room pass it down to produce report, else pass out a message string.
code_block_2 = CodeBlock { "Please select a Room."; }
if_ = If(test=equals, true=select_a_room, false=code_block_2)
equals_2 = List.Equals(object=if_, otherObject=code_block_2)

name_2 = Room.Name(room=if_)

# group: If set to False units will be converted to Square Feet. If True current project units will be used.
if_set_to_false_units_will_be = BoolSelector(false)  # "If set to False units will be converted to Square Feet. If True current project units will be used."; graph input

convert_default_square_feet = Python()  # IronPython2
# ---------- convert_default_square_feet.python (16 lines) ----------
# Import DocumentManager and TransactionManager
import clr
clr.AddReference("RevitServices")
import RevitServices
from RevitServices.Persistence import DocumentManager
doc = DocumentManager.Instance.CurrentDBDocument

# Import RevitAPI
clr.AddReference("RevitAPI")
import Autodesk
from Autodesk.Revit.DB import *

value = LabelUtils.GetLabelForUnit(UnitTypeId.SquareFeet)

#Assign your output to the OUT variable.
OUT = value
# ----------------------------------------

# group: Allowable Area per Occupant
allowable_area_per_occupant = DoubleInput(15)  # graph input

# group: Calculate Occupancy Load by dividing Area by Max Floor Area Allowance for given Occupancy Type.
string = StringInput("Area")
# note: Dynamo adopts its display units to whatever Revit project units are set to. We can either convert to Square Feet which feels natural for Occupancy Load Calculations or keep the current display units.
getParameterValueByName = Element.GetParameterValueByName(element=if_, parameterName=string)
toSquareFeet = Python(IN[0]=getParameterValueByName)  # "ConvertArea.ToSquareFeet"; IronPython2
# ---------- toSquareFeet.python (26 lines) ----------
# Import DocumentManager and TransactionManager
import clr
clr.AddReference("RevitServices")
import RevitServices
from RevitServices.Persistence import DocumentManager
doc = DocumentManager.Instance.CurrentDBDocument

# Import RevitAPI
clr.AddReference("RevitAPI")
import Autodesk
from Autodesk.Revit.DB import *

# Add reference to IronPython Lib folder
import sys
pyt_path = r'C:\Program Files (x86)\IronPython 2.7\Lib'
sys.path.append(pyt_path)

# Set up inputs
value = IN[0]

# Execute definition
projectUnits = Document.GetUnits(doc).GetFormatOptions(SpecTypeId.Area).GetUnitTypeId()
displayUnit = LabelUtils.GetLabelForUnit(projectUnits)

# Assign your output to the OUT variable
OUT = [UnitUtils.Convert(value, projectUnits, UnitTypeId.SquareFeet), displayUnit]
# ----------------------------------------
code_block_3 = CodeBlock(IN=toSquareFeet) { IN[0]; IN[1]; }
if_2 = If(test=if_set_to_false_units_will_be, true=getParameterValueByName, false=code_block_3.out0)
ceiling = Math.Ceiling(number=if_2)
div = if_2 / allowable_area_per_occupant
ceiling_2 = Math.Ceiling(number=div)

# group: Create Room Occupancy report by joining multiple strings into one.
code_block_4 = CodeBlock { "\n"; "Room Name: "; "Area: ~"; " "; "Occupancy Load: "; }
concat = String.Concat(string0=code_block_4.out1, string1=name_2)
string_from_object = FromObject(obj=ceiling)
if_3 = If(test=if_set_to_false_units_will_be, true=code_block_3.out1, false=convert_default_square_feet)
concat_2 = String.Concat(string0=code_block_4.out2, string1=string_from_object, string2=code_block_4.out3, string3=if_3)
string_from_object_2 = FromObject(obj=ceiling_2)
concat_3 = String.Concat(string0=code_block_4.out4, string1=string_from_object_2)
concat_4 = String.Concat(string0=concat, string1=code_block_4.out0, string2=concat_2, string3=code_block_4.out0, string4=code_block_4.out0, string5=concat_3)

if_4 = If(test=equals_2, true=code_block_2, false=concat_4)

# group: Output
calculation_results = Watch(if_4)  # graph output

select_model_element_by_category = DSModelElementByCategorySelection(index=486)  # nothing selected; graph input
