# Dynamo graph Calculate Total Length of Selected Lines.dyn (Dynamo 2.13.0.3135)
# author: Autodesk
# This workflow allows you to select multiple detail or model lines and find out their total length. By toggling the Boolean input to True, current project units will be used. When set to False, Revit's internal units of Feet will be used to display total length.

# group: Calculate Length
# Calculate Length of Selected Lines
# note: See graph properties for more information

# group: Selection
# Model/Detail Line Selection
select_detail_and_model_lines = DSModelElementsByCategorySelection("e424b4c3-e753-4e62-9bc6-6e9354ee0ddf-00069dba,e424b4c3-e753-4e62-9bc6-6e9354ee0ddf-00069dd7,e424b4c3-e753-4e62-9bc6-6e9354ee0ddf-00069e01")  # 3 picked in the model; graph input

# group: Get Lengths and Sum
# Get Length parameter from selected detail and model curves and sum up
string = StringInput("Length")
getParameterValueByName = Element.GetParameterValueByName(element=select_detail_and_model_lines, parameterName=string)
sum = Math.Sum(values=getParameterValueByName)

# group: Unit Toggle
# If set to False length will be calculated in FT. If True, current project units will be used.
set_true_for_current_project = BoolSelector(true)  # "Set True for current project units. Set False for units in feet."; graph input

# group: Unit Conversion
# Use builtin Revit utilities to swap units
# note: Dynamo adopts its display units to whatever Revit project Lenght units are set to. We can either convert to Feet or keep the project units.
toFeet = Python(IN[0]=sum)  # "ConvertLength.ToFeet"; IronPython2
# ---------- toFeet.python (26 lines) ----------
# Import DocumentManager and TransactionManager
import clr
clr.AddReference("RevitServices")
import RevitServices
from RevitServices.Persistence import DocumentManager
doc = DocumentManager.Instance.CurrentDBDocument

# Import RevitAPI
clr.AddReference("RevitAPI")
import Autodesk
from Autodesk.Revit.DB import *

# Add reference to IronPython Lib folder
import sys
pyt_path = r'C:\Program Files (x86)\IronPython 2.7\Lib'
sys.path.append(pyt_path)

# Set up inputs
value = IN[0]

# Execute definition
projectUnits = Document.GetUnits(doc).GetFormatOptions(SpecTypeId.Length).GetUnitTypeId()
displayUnit = LabelUtils.GetLabelForUnit(projectUnits)

# Assign your output to the OUT variable
OUT = [UnitUtils.Convert(value, projectUnits, UnitTypeId.Feet), displayUnit]
# ----------------------------------------
code_block = CodeBlock(IN=toFeet) { IN[0]; IN[1]; }

# group: Conditionals
# Swap units if user picks that option
count = List.Count(list=getParameterValueByName)
if_ = If(test=set_true_for_current_project, true=sum, false=code_block.out0)
code_block_2 = CodeBlock { "FEET"; }
if_2 = If(test=set_true_for_current_project, true=code_block.out1, false=code_block_2)

# group: Build Output
# combine strings and return output for Dynamo Player. By using addition in a code block we convert numbers to string automatically
code_block_3 = CodeBlock(curveCount=count, totalLength=if_, units=if_2)
# ---------- code_block_3.designscript (9 lines) ----------
//declare a few variables to combine for output
curveCount;
totalLength;
units;
//build output
//first line prefix + count + return line
"Selected Curves: " + curveCount + "\n" +
//second line prefix + total length + space + units
"Total Length: " + totalLength + " " + units;
# ----------------------------------------
calculation_results = Watch(code_block_3.out3)  # graph output
