# Dynamo graph Select All Not Keynoted in the Active View.dyn (Dynamo 2.13.0.2751)
# author: Autodesk
# This workflow selects all elements in the active Revit view that have empty Keynote parameters.

# group: Select All
# Not Keynoted in Active View
# note: See Graph Properties for More Information

# group: Collect
# Gets all elements to filter down to those without keynote values
all_elements_in_active_view = ElementsInView()

# group: First filter criteria
# Filter based on elements that can receive a keynote
code_block = CodeBlock { "Family"; }
getParameterValueByName = Element.GetParameterValueByName(element=all_elements_in_active_view, parameterName=code_block)
string = StringInput("")
ne = getParameterValueByName != string
# note: Filter Based on If element can get Keynote
filterByBoolMask = List.FilterByBoolMask(list=getParameterValueByName, mask=ne)

# group: Filter Instances
# Filter original (Selectable) instances of elements
filterByBoolMask_2 = List.FilterByBoolMask(list=all_elements_in_active_view, mask=ne)

# group: Second Filter Criteria
# Filter for elements without a keynote assigned
code_block_2 = CodeBlock { "Keynote"; }
getParameterValueByName_2 = Element.GetParameterValueByName(element=filterByBoolMask.in, parameterName=code_block_2)
code_block_3 = CodeBlock { ""; }
eq = getParameterValueByName_2 == code_block_3
filterByBoolMask_3 = List.FilterByBoolMask(list=filterByBoolMask_2.in, mask=eq)

# group: Build Output
# Give user feedback based on the operation
select_elems = Python(IN[0]=filterByBoolMask_3.in)  # CPython3
# ---------- select_elems.python (25 lines) ----------
import clr
clr.AddReference("RevitAPI")
clr.AddReference("RevitAPIUI")
import Autodesk
from Autodesk.Revit.UI import *
from Autodesk.Revit.DB import *
clr.AddReference("RevitServices")
import RevitServices
from RevitServices.Persistence import DocumentManager
clr.AddReference("RevitNodes")
import Revit
# clr.ImportExtensions(Revit.Elements)
from System.Collections.Generic import *

elems = UnwrapElement(IN[0])

elemIds = []
for elem in elems:
	elemIds.append(elem.Id)
	
uidoc = DocumentManager.Instance.CurrentUIDocument
uidoc.Selection.SetElementIds(List[ElementId](elemIds))

# Just for fun - give it to the output!
OUT = elemIds
# ----------------------------------------
count = List.Count(list=filterByBoolMask_3.in)
code_block_4 = CodeBlock(count=count) { count + " " + "Elements selected."; }
result = Watch(code_block_4)  # graph output
