# Dynamo graph ▶ About Dynamo Player.dyn "1 Press Play for More Information about Dynamo Player" (Dynamo 2.13.0.3135)
# author: Autodesk
# Generates a popup to describe what Dynamo player can do.

# group: Press Play
# Dynamo Player Preview Graph
# note: CATEGORY:
# Administration
# DESCRIPTION:
# This workflow pops up a message about Dynamo Player.
# The Dynamo Player application executes Dynamo graphs in the Revit environment. Dynamo graphs can be written to perform many complex functions in Revit, some of which can be very useful to minimize repetitive and time consuming tasks, to run model checks, or to extract and utilize information from the Revit model. Learn more at http://dynamobim.org.
# MODEL PREPARATION:
# - None
# NOTE:
#  - None
# AUTHORS:
# - Autodesk
# Copyright(c) 2021, Autodesk
# REQUIRED PACKAGES:
# - None

code_block = CodeBlock { "You just ran a Dynamo graph in Dynamo Player!" + "\n\n" +  "Dynamo Player executes Dynamo graph s for Revit. Graphs can perform many complex functions in Revit. They can minimize repetitive tasks, run Revit model checks, or extract and utilize information from the model."; }
code_block_2 = CodeBlock { "Learn more about Dynamo graphs at dynamobim.org"; }
python_script = Python(IN[0]=code_block, IN[1]=code_block_2)  # IronPython2
# ---------- python_script.python (15 lines) ----------
#This script pops up a dialog box with a message from the previous node.
import clr
clr.AddReference('RevitAPIUI')

from Autodesk.Revit.UI import TaskDialog

mainText = IN[0]
footerText = IN[1]

messagePop = TaskDialog("Dynamo Player")
messagePop.MainContent = mainText + "\n\n" + "<a href=\"http://dynamobim.org/ \">" + footerText + "</a>";

messagePop.Show()

OUT = "Success!"
# ----------------------------------------
result = Watch(python_script)  # graph output
